# Grasshopper definition hopper.gh (Grasshopper 1.0.7)

get_integer = GetInteger(AtLeast=1, AtMost=2147483647, Maximum=2147483647, Minimum=-2147483648)
get = GetInteger(AtLeast=1, AtMost=2147483647, Maximum=2147483647, Minimum=-2147483648)
multiplication = Multiplication(A=get_integer, B=get)

# ---- group: RH_OUT:o
num = Number(multiplication)
